# Grasshopper definition moire_cylinder_v5.gh (Grasshopper 1.0.8)

# ---- group: UserInputs
outertwist = Slider(-105, range=-360..360)
outerspokethickness = Slider(0.25, range=0..1)
innercirclediameter = Slider(3, range=1..6)
innercirclewidth = Slider(0.25, range=0.125..2)
baseheight = Slider(1, range=0.063..1)
innerspokecount = Slider(4, range=0..50)
numberoftweencircles = Slider(8, range=1..10)
outerspokecount = Slider(5, range=0..50)
innertwist = Slider(74, range=-360..360)
innerspokethickness = Slider(0.25, range=0..1)
outercirclewdith = Slider(0.25, range=0.125..2)
spireheight = Slider(3, range=1..9)

# ---- group: BaseRings
pt = Point(<point referenced from the Rhino model>)
pdecon = Deconstruct(Point=pt)  # -> XComponent, YComponent, ZComponent
addition = Addition(A=pdecon.ZComponent, B=baseheight)
pt_2 = ConstructPoint(XCoordinate=pdecon.XComponent, YCoordinate=pdecon.YComponent, ZCoordinate=addition)

# ----
subtraction = Subtraction(A=pdecon.ZComponent, B="3.55")
subtraction_2 = Subtraction(A=pdecon.ZComponent, B="3.75")
subtraction_3 = Subtraction(A=pdecon.ZComponent, B="3.55 - .6")
pt_3 = ConstructPoint(XCoordinate=pdecon.XComponent, YCoordinate=pdecon.YComponent, ZCoordinate=subtraction_2)
pt_4 = ConstructPoint(XCoordinate=pdecon.XComponent, YCoordinate=pdecon.YComponent, ZCoordinate=subtraction)

# ---- group: BaseRings / InnerCircleBottom
division = Division(A=innercirclediameter, B="2")
addition_2 = Addition(A=division, B=innercirclewidth)
innerinnerbottom = Circle(Plane=pt, Radius=division)
innerouterbottom = Circle(Plane=pt, Radius=addition_2)

# ---- group: BaseRings / OuterCircleBottom
clearance = Panel("0.015625")
addition_3 = Addition(A=addition_2, B=clearance)
addition_4 = Addition(A=addition_3, B=outercirclewdith)
cir = Circle(Plane=pt, Radius=addition_3)
cir_2 = Circle(Plane=pt, Radius=addition_4)

# ----
pt_5 = ConstructPoint(XCoordinate=pdecon.XComponent, YCoordinate=pdecon.YComponent, ZCoordinate=subtraction_3)
cir_3 = Circle(Plane=pt_4, Radius=addition_3)
cir_4 = Circle(Plane=pt_4, Radius=".7685")
cir_5 = Circle(Plane=pt_3, Radius=addition_4)
cir_6 = Circle(Plane=pt_4, Radius=".5185")
cir_7 = Circle(Plane=pt_5, Radius=".7685")
cir_8 = Circle(Plane=pt_5, Radius=".5185")
loft = Loft(
    Curves=[cir_6, cir_8, cir_7, cir_4, cir_3, innerinnerbottom, cir_2, cir_5],
    Options={Adjust=False, Closed=False, LoftEnds=0, LoftSimp=0, LoftType=3, Rebuild=10, Refit=0.01})
boundary = BoundarySurfaces(Edges=cir_6)
boundary_2 = BoundarySurfaces(Edges=cir_5)

# ---- group: BaseRings / InnerCircleTop
division_2 = Division(A=innercirclediameter, B="2")
addition_5 = Addition(A=division_2, B=innercirclewidth)
innerinnertop = Circle(Plane=pt_2, Radius=division_2)
inneroutertop = Circle(Plane=pt_2, Radius=addition_5)

# ---- group: BaseRings / OuterCircleTop
addition_6 = Addition(A=addition_5, B=clearance)
addition_7 = Addition(A=addition_6, B=outercirclewdith)
cir_9 = Circle(Plane=pt_2, Radius=addition_6)
cir_10 = Circle(Plane=pt_2, Radius=addition_7)

# ----
bvol = BoundaryVolume(Boundaries=[boundary_2, loft, boundary])

# ---- group: BaseRings / InnerRingNotchCircle
division_3 = Division(A=addition, B="2")
expression = Expression(x=addition_5, y=clearance, z=outercirclewdith, Expression="x - ((y + z)/2)")
pt_6 = ConstructPoint(XCoordinate=pdecon.XComponent, YCoordinate=pdecon.YComponent, ZCoordinate=division_3)
inneroutertop_2 = Circle(Plane=pt_6, Radius=expression)

# ----
division_4 = Division(A=innercirclewidth, B="4")
division_5 = Division(A=baseheight, B="2")

# ---- group: BaseRings / OuterRingNotchCircle
addition_8 = Addition(A=expression, B=clearance)
inneroutertop_3 = Circle(Plane=pt_6, Radius=addition_8)

# ----
subtraction_4 = Subtraction(A=division_5, B=".01")
subtraction_5 = Subtraction(A=division_4, B=".005")

# ---- group: BaseRings / InnerRing
loft_opt = LoftOptions(Closed=Toggle(True), Adjust=False, Rebuild=0, Refit=0, Type="3")
innerringfinal = Loft(Curves=[inneroutertop, innerinnertop, innerinnerbottom, innerouterbottom, inneroutertop_2], Options=loft_opt)

# ---- group: BaseRings / OuterRing
loft_opt_2 = LoftOptions(Closed=Toggle(True), Adjust=False, Rebuild=0, Refit=0, Type="3")
outerringfinal = Loft(Curves=[cir, cir_2, cir_10, cir_9, inneroutertop_3], Options=loft_opt_2)

# ----
vec = VectorXYZ(XComponent=0, YComponent=0, ZComponent=subtraction_4)  # -> Vector, Length

# ---- group: HeightPointAdjustment
pdecon_2 = Deconstruct(Point=pt_2)  # -> XComponent, YComponent, ZComponent
addition_9 = Addition(A=pdecon_2.ZComponent, B=spireheight)
pt_7 = ConstructPoint(XCoordinate=pdecon_2.XComponent, YCoordinate=pdecon_2.YComponent, ZCoordinate=addition_9)

# ---- group: BaseRings / AddFillet
number_slider = Slider(0.25, range=0..1)
debrep = DeconstructBrep(Brep=innerringfinal)  # -> Faces, Edges, Vertices
debrep_2 = DeconstructBrep(Brep=outerringfinal)  # -> Faces, Edges, Vertices
filedge = FilletEdge(Shape=innerringfinal, Blend=0, Metric=0, Edges="9", Radii=number_slider)
filedge_2 = FilletEdge(Shape=outerringfinal, Blend=0, Metric=0, Edges="9", Radii=number_slider)

# ----
darc = DeconstructArc(Arc=cir_9)  # -> BasePlane, Radius, Angle
darc_2 = DeconstructArc(Arc=cir_10)  # -> BasePlane, Radius, Angle
expression_2 = Expression(x=numberoftweencircles, Expression="x + 1")
darc_3 = DeconstructArc(Arc=innerinnertop)  # -> BasePlane, Radius, Angle
darc_4 = DeconstructArc(Arc=inneroutertop)  # -> BasePlane, Radius, Angle
expression_3 = Expression(x=numberoftweencircles, Expression="x + 1")
addition_10 = Addition(A=baseheight, B=spireheight)
subtraction_6 = Subtraction(A=addition_9, B=addition)
subtraction_7 = Subtraction(A=addition_9, B=addition)
avr = Average(Input=[darc.Radius, darc_2.Radius])

# ---- group: UppInnerRingNotches
cir_11 = Circle(Plane=pt, Radius=avr)
divide = DivideCurve(Curve=cir_11, Count="8", Kinks=False)  # -> Points, Tangents, Parameters
division_6 = Division(A=innercirclewidth, B="4")
division_7 = Division(A=baseheight, B="2")
cir_12 = Circle(Plane=divide.Points, Radius=division_6)
vec_2 = VectorXYZ(XComponent=0, YComponent=0, ZComponent=division_7)  # -> Vector, Length
extr = Extrude(Base=cir_12, Direction=vec_2.Vector)
cap = CapHoles(Brep=extr)  # -> reverse(Brep)
flatten = FlattenTree(Tree=cap, Path="{0}")

# ----
cir_13 = Circle(Plane=divide.Points, Radius=subtraction_5)
extr_2 = Extrude(Base=cir_13, Direction=vec.Vector)
cap_2 = CapHoles(Brep=extr_2)
flatten_2 = FlattenTree(Tree=cap_2, Path="{0}")
panel = Panel(cap)
sdiff = SolidDifference(BrepsA=filedge_2, BrepsB=cap)
avr_2 = Average(Input=[darc_3.Radius, darc_4.Radius])
division_8 = Division(A=subtraction_7, B=expression_3)
division_9 = Division(A=addition_10, B=expression_2)
panel_2 = Panel(flatten)
division_10 = Division(A=outertwist, B=expression_2)
division_11 = Division(A=innertwist, B=expression_3)
addition_11 = Addition(A=expression_2, B="1")
addition_12 = Addition(A=expression_3, B="1")
series = Series(Start=0, Step=division_9, Count=addition_11)
series_2 = Series(Start=0, Step=division_10, Count=addition_11)
series_3 = Series(Start=addition, Step=division_8, Count=addition_12)
series_4 = Series(Start=0, Step=division_11, Count=addition_12)
pt_8 = ConstructPoint(XCoordinate=0, YCoordinate=0, ZCoordinate=series)
pt_9 = ConstructPoint(XCoordinate=0, YCoordinate=0, ZCoordinate=series_3)
rad = Radians(Degrees=series_2)
rad_2 = Radians(Degrees=series_4)
panel_3 = Panel(series_3)
cir_14 = Circle(Plane=pt_9, Radius=avr_2)
cir_15 = Circle(Plane=pt_8, Radius=avr)
rotate = Rotate(Geometry=cir_15, Angle=rad, Plane=PlaneXY(0, 0, 0))  # -> Geometry, Transform
rotate_2 = Rotate(Geometry=cir_14, Angle=rad_2, Plane=PlaneXY(0, 0, 0))  # -> Geometry, Transform
divide_2 = DivideCurve(Curve=rotate.Geometry, Count=outerspokecount, Kinks=False)  # -> Points, Tangents, Parameters
divide_3 = DivideCurve(Curve=rotate_2.Geometry, Count=innerspokecount, Kinks=False)  # -> Points, Tangents, Parameters
flip = FlipMatrix(Data=divide_2.Points)
flip_2 = FlipMatrix(Data=divide_3.Points)
intcrv = Interpolate(Vertices=flip, Degree=Slider(3, range=0..5), Periodic=False, KnotStyle=1)  # -> Curve, Length, Domain
intcrv_2 = Interpolate(Vertices=flip_2, Degree=Slider(3, range=0..5), Periodic=False, KnotStyle=1)  # -> Curve, Length, Domain
eval = EvaluateCurve(Curve=reparameterize(intcrv.Curve), Parameter="1")  # -> Point, Tangent, Angle
expression_4 = Expression(x=subtraction_6, y=addition, Expression="(x/2) + y")
eval_2 = EvaluateCurve(Curve=reparameterize(intcrv_2.Curve), Parameter="1")  # -> Point, Tangent, Angle
expression_5 = Expression(x=subtraction_7, y=addition, Expression="(x/2) + y")
pl = PlaneNormal(Origin=eval.Point, ZAxis=Vector(0, 0, 1))
vec2pt = Vector2Pt(PointA=eval.Point, PointB=pt_7, Unitize=False)  # -> Vector, Length
pl_2 = PlaneNormal(Origin=eval_2.Point, ZAxis=Vector(0, 0, 1))
vec2pt_2 = Vector2Pt(PointA=eval_2.Point, PointB=pt_7, Unitize=False)  # -> Vector, Length
pt_10 = ConstructPoint(XCoordinate=0, YCoordinate=0, ZCoordinate=expression_4)
pt_11 = ConstructPoint(XCoordinate=0, YCoordinate=0, ZCoordinate=expression_5)
eval_3 = EvaluateCurve(Curve=reparameterize(intcrv.Curve), Parameter=".5")  # -> Point, Tangent, Angle
expression_6 = Expression(x=outercirclewdith, Expression="-x/1")
expression_7 = Expression(x=outerspokethickness, Expression="-x/4")
expression_8 = Expression(x=outercirclewdith, Expression="x/2")
expression_9 = Expression(x=outerspokethickness, Expression="x/4")
eval_4 = EvaluateCurve(Curve=reparameterize(intcrv_2.Curve), Parameter=".5")  # -> Point, Tangent, Angle
expression_10 = Expression(x=innercirclewidth, Expression="-x/2")
expression_11 = Expression(x=innerspokethickness, Expression="-x/4")
eval_5 = EvaluateCurve(Curve=reparameterize(intcrv.Curve), Parameter="0")  # -> Point, Tangent, Angle
expression_12 = Expression(x=innercirclewidth, Expression="x/2")
expression_13 = Expression(x=innerspokethickness, Expression="x/4")
eval_6 = EvaluateCurve(Curve=reparameterize(intcrv_2.Curve), Parameter="0")  # -> Point, Tangent, Angle
align = AlignPlane(Plane=pl, Direction=vec2pt.Vector)  # -> Plane, Angle
align_2 = AlignPlane(Plane=pl_2, Direction=vec2pt_2.Vector)  # -> Plane, Angle
expression_14 = Expression(x=outercirclewdith, Expression="-x/1")
dom = ConstructDomain(DomainStart=expression_6, DomainEnd=expression_8)
expression_15 = Expression(x=outerspokethickness, Expression="-x/4")
dom_2 = ConstructDomain(DomainStart=expression_7, DomainEnd=expression_9)
expression_16 = Expression(x=outercirclewdith, Expression="x/2")
expression_17 = Expression(x=outerspokethickness, Expression="x/4")
expression_18 = Expression(x=innercirclewidth, Expression="-x/2")
dom_3 = ConstructDomain(DomainStart=expression_10, DomainEnd=expression_12)
expression_19 = Expression(x=innerspokethickness, Expression="-x/4")
dom_4 = ConstructDomain(DomainStart=expression_11, DomainEnd=expression_13)
expression_20 = Expression(x=outercirclewdith, Expression="-x/1")
expression_21 = Expression(x=innercirclewidth, Expression="x/2")
expression_22 = Expression(x=outerspokethickness, Expression="-x/4")
expression_23 = Expression(x=innerspokethickness, Expression="x/4")
expression_24 = Expression(x=outercirclewdith, Expression="x/2")
expression_25 = Expression(x=outerspokethickness, Expression="x/4")
expression_26 = Expression(x=innercirclewidth, Expression="-x/2")
expression_27 = Expression(x=innerspokethickness, Expression="-x/4")
expression_28 = Expression(x=innercirclewidth, Expression="x/2")
expression_29 = Expression(x=innerspokethickness, Expression="x/4")
vec2pt_3 = Vector2Pt(PointA=eval_3.Point, PointB=pt_10, Unitize=False)  # -> Vector, Length
pl_3 = PlaneNormal(Origin=eval_3.Point, ZAxis=Vector(0, 0, 1))
vec2pt_4 = Vector2Pt(PointA=eval_4.Point, PointB=pt_11, Unitize=False)  # -> Vector, Length
pl_4 = PlaneNormal(Origin=eval_4.Point, ZAxis=Vector(0, 0, 1))
vec2pt_5 = Vector2Pt(PointA=eval_5.Point, PointB=pt_2, Unitize=False)  # -> Vector, Length
pl_5 = PlaneNormal(Origin=eval_5.Point, ZAxis=Vector(0, 0, 1))
vec2pt_6 = Vector2Pt(PointA=eval_6.Point, PointB=pt_2, Unitize=False)  # -> Vector, Length
pl_6 = PlaneNormal(Origin=eval_6.Point, ZAxis=Vector(0, 0, 1))
rectangle = Rectangle(Plane=align.Plane, XSize=dom, YSize=dom_2, Radius=0)  # -> Rectangle, Length
dom_5 = ConstructDomain(DomainStart=expression_14, DomainEnd=expression_16)
dom_6 = ConstructDomain(DomainStart=expression_15, DomainEnd=expression_17)
rectangle_2 = Rectangle(Plane=align_2.Plane, XSize=dom_3, YSize=dom_4, Radius=0)  # -> Rectangle, Length
dom_7 = ConstructDomain(DomainStart=expression_18, DomainEnd=expression_21)
dom_8 = ConstructDomain(DomainStart=expression_19, DomainEnd=expression_23)
dom_9 = ConstructDomain(DomainStart=expression_20, DomainEnd=expression_24)
dom_10 = ConstructDomain(DomainStart=expression_22, DomainEnd=expression_25)
dom_11 = ConstructDomain(DomainStart=expression_26, DomainEnd=expression_28)
dom_12 = ConstructDomain(DomainStart=expression_27, DomainEnd=expression_29)
divide_4 = DivideCurve(Curve=cir_15, Count=outerspokecount, Kinks=False)  # -> Points, Tangents, Parameters
graft = GraftTree(Tree=rectangle.Rectangle, IncludeEmptyLists=True, IncludeNullItems=True)
graft_2 = GraftTree(Tree=rectangle_2.Rectangle, IncludeEmptyLists=True, IncludeNullItems=True)
align_3 = AlignPlane(Plane=pl_3, Direction=vec2pt_3.Vector)  # -> Plane, Angle
rectangle_3 = Rectangle(Plane=align_3.Plane, XSize=dom_5, YSize=dom_6, Radius=0)  # -> Rectangle, Length
align_4 = AlignPlane(Plane=pl_4, Direction=vec2pt_4.Vector)  # -> Plane, Angle
rectangle_4 = Rectangle(Plane=align_4.Plane, XSize=dom_7, YSize=dom_8, Radius=0)  # -> Rectangle, Length
align_5 = AlignPlane(Plane=pl_5, Direction=vec2pt_5.Vector)  # -> Plane, Angle
rectangle_5 = Rectangle(Plane=align_5.Plane, XSize=dom_9, YSize=dom_10, Radius=0)  # -> Rectangle, Length
align_6 = AlignPlane(Plane=pl_6, Direction=vec2pt_6.Vector)  # -> Plane, Angle
rectangle_6 = Rectangle(Plane=align_6.Plane, XSize=dom_11, YSize=dom_12, Radius=0)  # -> Rectangle, Length
flip_3 = FlipMatrix(Data=divide_4.Points)
graft_3 = GraftTree(Tree=rectangle_3.Rectangle, IncludeEmptyLists=True, IncludeNullItems=True)
graft_4 = GraftTree(Tree=rectangle_4.Rectangle, IncludeEmptyLists=True, IncludeNullItems=True)
graft_5 = GraftTree(Tree=rectangle_5.Rectangle, IncludeEmptyLists=True, IncludeNullItems=True)
graft_6 = GraftTree(Tree=rectangle_6.Rectangle, IncludeEmptyLists=True, IncludeNullItems=True)

# ---- group: Verticals
divide_5 = DivideCurve(Curve=cir_14, Count=innerspokecount, Kinks=False)  # -> Points, Tangents, Parameters
flip_4 = FlipMatrix(Data=divide_5.Points)
pline = PolyLine(Vertices=flip_4, Closed=False)
swp1 = Sweep1(Rail=pline, Sections=graft_6, Miter=1)

# ----
pline_2 = PolyLine(Vertices=flip_3, Closed=False)
swp1_2 = Sweep1(Rail=intcrv.Curve, Sections=[graft, graft_5, graft_3], Miter=1)
swp1_3 = Sweep1(Rail=intcrv_2.Curve, Sections=[graft_2, graft_6, graft_4], Miter=1)
expression_30 = Expression(x=outerspokecount, Expression="(360 / (x * 2)) ")
swp1_4 = Sweep1(Rail=pline_2, Sections=graft_5, Miter=1)
cap_3 = CapHoles(Brep=swp1_2)
expression_31 = Expression(x=addition_4, Expression="x + 1")
expression_32 = Expression(x=addition_4, Expression="-x - 1")
cap_4 = CapHoles(Brep=swp1_3)
cap_5 = CapHoles(Brep=swp1_4)
mirror = Mirror(Geometry=cap_3, Plane=PlaneYZ(0, 0, 0))  # -> Geometry, Transform
rad_3 = Radians(Degrees=expression_30)
dom_13 = ConstructDomain(DomainStart=expression_32, DomainEnd=expression_31)
rotate_3 = Rotate(Geometry=mirror.Geometry, Angle=rad_3, Plane=PlaneXY(0, 0, 0))  # -> Geometry, Transform
planesrf = PlaneSurface(Plane=pt_3, XSize=dom_13, YSize=dom_13)
cap_6 = CapHoles(Brep=swp1)
xy = XYPlane(Origin=Point(0, 0, 0))
mirror_2 = Mirror(Geometry=[cap_5, rotate_3.Geometry], Plane=xy)  # -> Geometry, Transform
splitmul = SplitBrepMultiple(Brep=mirror_2.Geometry, Cutters=planesrf)
# Spiral
sunion = SolidUnion(Breps=[cap_4, cap_3, cap_6, cap_5, sdiff, filedge])
# Base
sunion_2 = SolidUnion(Breps=[flatten_2, bvol, splitmul])
